# Dynamo graph Pipe Hangers by KT.dyn (Dynamo 2.19.3.6394)
# packages: GenerativeDesign.Revit 6.1.3.0, Clockwork for Dynamo 2.x 2.12.2

# group: Input
select_hanger_family = FamilyTypes("Dynamo Clevis Hanger:Dynamo Clevis Hanger")  # graph input
select_pipes = DSModelElementMutlipleSelection()  # 11 picked in the model; graph input
distance_between_hangers = DoubleInput(2000)  # graph input
distance_from_fitting = DoubleInput(150)  # graph input

location = Custom[Element.Location](element=select_pipes)  # package Clockwork for Dynamo 2.x; Returns the location of an element as point, curve or curve loop, along with some booleans to help filtering the results. Unlike the OOTB Element.GetLocation node, it also returns sketch lines of sketch-based elements like floor slabs as well as the element's rotation property. Additionally, it supports quite a few more element types (e.g. railings, stairs etc.).
integer_slider = IntegerSlider(2000, range=0..2000 step 1)
length = Curve.Length(curve=location.curves)
range = Range(start=integer_slider, end=length, step=distance_between_hangers, lacing=Longest)
pointAtSegmentLength = Curve.PointAtSegmentLength(curve=location.curves, segmentLength=range)
byPoint = FamilyInstance.ByPoint(familyType=select_hanger_family, point=pointAtSegmentLength)
code_block = CodeBlock { "Outside Pipe Diameter"; }
code_block_2 = CodeBlock { "Outside Diameter"; }
getParameterValueByName = Element.GetParameterValueByName(element=select_pipes, parameterName=code_block_2)
setParameterByName = Element.SetParameterByName(element=byPoint, parameterName=code_block, value=getParameterValueByName)
startPoint = Curve.StartPoint(curve=location.curves)
X = Point.X(point=startPoint)
endPoint = Curve.EndPoint(curve=location.curves)
X_2 = Point.X(point=endPoint)
eq = X == X_2
filterByBoolMask = List.FilterByBoolMask(list=byPoint, mask=eq)
boolean = BoolSelector(false)
clean = List.Clean(list=filterByBoolMask.out, preserveIndices=boolean)
code_block_3 = CodeBlock { 90; }
setRotation = FamilyInstance.SetRotation(familyInstance=clean, degree=code_block_3)
startPoint_2 = Curve.StartPoint(curve=location.curves)
endPoint_2 = Curve.EndPoint(curve=location.curves)
byTwoPoints = Vector.ByTwoPoints(start=startPoint_2, end=endPoint_2)
translate = Geometry.Translate(geometry=location.curves, direction=byTwoPoints, distance=distance_from_fitting)
code_block_4 = CodeBlock { 0; }
pointAtSegmentLength_2 = Curve.PointAtSegmentLength(curve=translate, segmentLength=code_block_4)
byPoint_2 = FamilyInstance.ByPoint(familyType=select_hanger_family, point=pointAtSegmentLength_2)
code_block_5 = CodeBlock { "Outside Pipe Diameter"; }
setParameterByName_2 = Element.SetParameterByName(element=byPoint_2, parameterName=code_block_5, value=getParameterValueByName)
reverse = Curve.Reverse(curve=location.curves)
startPoint_3 = Curve.StartPoint(curve=reverse)
endPoint_3 = Curve.EndPoint(curve=reverse)
byTwoPoints_2 = Vector.ByTwoPoints(start=startPoint_3, end=endPoint_3)
translate_2 = Geometry.Translate(geometry=reverse, direction=byTwoPoints_2, distance=distance_from_fitting)
code_block_6 = CodeBlock { 0; }
pointAtSegmentLength_3 = Curve.PointAtSegmentLength(curve=translate_2, segmentLength=code_block_6)
byPoint_3 = FamilyInstance.ByPoint(familyType=select_hanger_family, point=pointAtSegmentLength_3)
code_block_7 = CodeBlock { "Outside Pipe Diameter"; }
setParameterByName_3 = Element.SetParameterByName(element=byPoint_3, parameterName=code_block_7, value=getParameterValueByName)
startPoint_4 = Curve.StartPoint(curve=location.curves)
X_3 = Point.X(point=startPoint_4)
endPoint_4 = Curve.EndPoint(curve=location.curves)
X_4 = Point.X(point=endPoint_4)
eq_2 = X_3 == X_4
filterByBoolMask_2 = List.FilterByBoolMask(list=byPoint_2, mask=eq_2)
boolean_2 = BoolSelector(false)
clean_2 = List.Clean(list=filterByBoolMask_2.out, preserveIndices=boolean_2)
code_block_8 = CodeBlock { 90; }
setRotation_2 = FamilyInstance.SetRotation(familyInstance=clean_2, degree=code_block_8)
list_create = List.Create(item0=byPoint_2, item1=byPoint_3)
flatten = List.Flatten(list=list_create)
startPoint_5 = Curve.StartPoint(curve=location.curves)
X_5 = Point.X(point=startPoint_5)
endPoint_5 = Curve.EndPoint(curve=location.curves)
X_6 = Point.X(point=endPoint_5)
eq_3 = X_5 == X_6
filterByBoolMask_3 = List.FilterByBoolMask(list=byPoint_3, mask=eq_3)
boolean_3 = BoolSelector(false)
clean_3 = List.Clean(list=filterByBoolMask_3.out, preserveIndices=boolean_3)
code_block_9 = CodeBlock { 90; }
setRotation_3 = FamilyInstance.SetRotation(familyInstance=clean_3, degree=code_block_9)
