# Dynamo graph Room Occupancy by KT.dyn (Dynamo 2.19.3.6394)
# packages: Data-Shapes 2022.2.105, Genius Loci 2024.2.26

code_block = CodeBlock { "Select Rooms"; }
categories = Categories("OST_Rooms")
all_elements_of_category = ElementsOfCategory(Category=categories)
name = Room.Name(room=all_elements_of_category)
dropdown_data = Custom[DropDown Data](InputName=code_block, Keys=name, Values=all_elements_of_category)  # package Data-Shapes; Create data for DropDown input in UI.MultiInputForm ++ . Check out www.data-shapes.net for more infos.
code_block_2 = CodeBlock { 1; }
multipleinputform = Custom[MultipleInputForm ++](Inputs=dropdown_data, Toggle=code_block_2)  # package Data-Shapes; Create a form with multiple inputs. see www.data-shapes.net for tutorials and infos!
name_2 = Room.Name(room=multipleinputform.User_Inputs)
room_byname = Custom[Room ByName](NameOrNumber=name_2)  # package Genius Loci; Enter the room/space name or number to get the room.
code_block_3 = CodeBlock { "Occupancy"; }
area = Room.Area(room=room_byname.Rooms)
code_block_4 = CodeBlock { 10; }
div = area / code_block_4
code_block_5 = CodeBlock { 0.495; }
add = div + code_block_5
code_block_6 = CodeBlock { 0; }
number_to_rounded_string = Custom[Number to Rounded String](Number=add, Decimals=code_block_6)  # package Data-Shapes; Returns rounded number to specified number of decimals as string
setParameterByName = Element.SetParameterByName(element=room_byname.Rooms, parameterName=code_block_3, value=number_to_rounded_string)
